# Grasshopper definition MAIN LOGIC.gh (Grasshopper 1.0.8)
# plug-ins: Heteroptera, Pufferfish, Human, BubalusGH2.0, LunchBox

# ----
# Press the button to make sure the file is
# updated to latest Wasp version on your pc.
button = Button()
# # Wasp: Discrete Design with Grasshopper plug-in (GPL) initiated by Andrea Rossi
# 
# 
# This file is part of Wasp.
# 
# Copyright (c) 2021, Andrea Rossi <a.rossi.andrea@gmail.com>
# 
# Wasp is free software; you can redistribute it and/or modify it under the terms of the GNU General Public License as published by the Free Software Foundation; either version 3 of the License, or (at your option) any later version.
# 
# Wasp is distributed in the hope that it will be useful, but WITHOUT ANY WARRANTY; without even the implied warranty of MERCHANTABILITY or FITNESS FOR A PARTICULAR PURPOSE. See the GNU General Public License for more details. You should have received a copy of the GNU General Public License
#  along with Wasp; If not, see <http://www.gnu.org/licenses/>.
# 
# license GPL-3.0 <https://www.gnu.org/licenses/gpl.html>
# 
# Significant parts of Wasp have been developed by Andrea Rossi as part of research on digital materials and discrete design at DDU Digital Design Unit - Prof. Oliver Tessmann - Technische Universität Darmstadt
updatefile = Wasp_UpdateFile(UPDATE=button)  # -> LOG; inputs UPDATE: Boolean; plug-in component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

connections = Slider(3, range=2..10)
seed = Slider(23, range=0..100)
direction = Slider(1, range=0..3)
parts_num = Slider(100, range=0..500)
type_of_construction = Slider(1, range=0..2)
test_score = BooleanToggle(False)
parts_num_2 = Slider(0, range=0..500)
reset = Button()

query_model_objects = QueryModelObjects(Layer="CURVES", Locked=True, Hidden=True, AutoUpdateState=True)  # -> graft(Objects)
center = Center(Geometry=query_model_objects)  # -> Center, Dimension
construct_point = ConstructPoint(XCoordinate=0, YCoordinate=0, ZCoordinate=0)
move_to_point = MoveToPoint(Geometry=query_model_objects, PointA=center.Center, PointB=construct_point)  # -> simplify(Moved), Vector, Transform
number_slider = Slider(15, range=0..20)
number_slider_2 = Slider(8, range=0..10)
explode = Explode(Curve=move_to_point.Moved, Recursive=True)  # -> Segments, Vertices
platonic_cube = PlatonicCube(Plane=explode.Vertices, Radius=number_slider, Truncation=0)
fast_sweep = FastSweep(Rail=explode.Segments, X=number_slider_2, Y=number_slider_2)
explode_2 = Explode(Curve=query_model_objects, Recursive=True)  # -> Segments, Vertices
cap_holes = CapHoles(Brep=fast_sweep)
deconstruct_brep = DeconstructBrep(Brep=platonic_cube)  # -> simplify(Faces), Edges, Vertices
platonic_cube_2 = PlatonicCube(Plane=explode_2.Vertices, Radius=number_slider, Truncation=0)
fast_sweep_2 = FastSweep(Rail=explode_2.Segments, X=number_slider_2, Y=number_slider_2)
merge = Merge(Data1=platonic_cube, Data2=cap_holes)  # -> simplify(Result)
center_2 = Center(Geometry=deconstruct_brep.Faces)  # -> Center, Dimension
brep_curve = BrepCurve(Brep=platonic_cube, Curve=move_to_point.Moved)  # -> Curves, simplify(Points)
cap_holes_2 = CapHoles(Brep=fast_sweep_2)
solid_union = SolidUnion(Breps=merge)
deconstruct_brep_2 = DeconstructBrep(Brep=platonic_cube_2)  # -> simplify(Faces), Edges, Vertices
merge_2 = Merge(Data1=platonic_cube_2, Data2=cap_holes_2)  # -> simplify(Result)
mesh_brep = MeshBrep(
    Brep=solid_union,
    Settings={GridMaxCount=0, GridMinCount=16, JaggedSeams=False, MaxEdgeLength=0, MinEdgeLength=0.0001, MinTolerance=0, Refine=True, RefineAngle=0, RelativeTolerance=0.65, SimplePlanes=True, Tolerance=0})
merge_3 = Merge(Data1=brep_curve.Points, Data2=center_2.Center)
center_3 = Center(Geometry=deconstruct_brep_2.Faces)  # -> Center, Dimension
brep_curve_2 = BrepCurve(Brep=platonic_cube_2, Curve=query_model_objects)  # -> Curves, simplify(Points)
solid_union_2 = SolidUnion(Breps=merge_2)
trim_tree = TrimTree(Tree=merge_3, Depth=1)
mesh_brep_2 = MeshBrep(
    Brep=solid_union_2,
    Settings={GridMaxCount=0, GridMinCount=16, JaggedSeams=False, MaxEdgeLength=0, MinEdgeLength=0.0001, MinTolerance=0, Refine=True, RefineAngle=0, RelativeTolerance=0.65, SimplePlanes=True, Tolerance=0})
merge_4 = Merge(Data1=brep_curve_2.Points, Data2=center_3.Center)
cull_duplicates = CullDuplicates(Points=trim_tree, Tolerance=0.1, CullMode=2)  # -> Points, Indices, Valence
trim_tree_2 = TrimTree(Tree=merge_4, Depth=1)
list_length = ListLength(List=cull_duplicates.Points)
cull_duplicates_2 = CullDuplicates(Points=trim_tree_2, Tolerance=0.1, CullMode=2)  # -> Points, Indices, Valence
random = Random(Range=list_length, Number=connections, Seed=seed)
flatten_tree = FlattenTree(Tree=deconstruct_brep.Faces, Path="{0}")
list_length_2 = ListLength(List=cull_duplicates_2.Points)
list_item = ListItem(List=cull_duplicates.Points, Index=random, Wrap=True)  # -> simplify(graft(Item))
random_2 = Random(Range=list_length_2, Number=connections, Seed=seed)
flatten_tree_2 = FlattenTree(Tree=deconstruct_brep_2.Faces, Path="{0}")
brep_closest_point = BrepClosestPoint(Point=list_item, Brep=flatten_tree)  # -> Point, Normal, simplify(Distance)
list_item_2 = ListItem(List=cull_duplicates_2.Points, Index=random_2, Wrap=True)  # -> simplify(graft(Item))
boolean = Boolean(invert(brep_closest_point.Distance))
brep_closest_point_2 = BrepClosestPoint(Point=list_item_2, Brep=flatten_tree_2)  # -> Point, Normal, simplify(Distance)
cull_pattern = CullPattern(List=flatten_tree, CullPattern=boolean)
boolean_2 = Boolean(invert(brep_closest_point_2.Distance))
explode_3 = Explode(Curve=cull_pattern, Recursive=True)  # -> Segments, Vertices
cull_pattern_2 = CullPattern(List=flatten_tree_2, CullPattern=boolean_2)
curve_middle = CurveMiddle(Curve=explode_3.Segments)  # -> simplify(Midpoint)
explode_4 = Explode(Curve=cull_pattern_2, Recursive=True)  # -> Segments, Vertices
tree_statistics = TreeStatistics(Tree=curve_middle)  # -> Paths, Length, Count
curve_middle_2 = CurveMiddle(Curve=explode_4.Segments)  # -> simplify(Midpoint)
list_item_3 = ListItem(List=curve_middle, Index=direction, Wrap=True)
tree_statistics_2 = TreeStatistics(Tree=curve_middle_2)  # -> Paths, Length, Count
line = Line(StartPoint=list_item, EndPoint=list_item_3)  # -> simplify(Line)
trim_tree_3 = TrimTree(Tree=list_item, Depth=1)
list_item_4 = ListItem(List=curve_middle_2, Index=direction, Wrap=True)
trim_tree_4 = TrimTree(Tree=line, Depth=1)
line_2 = Line(StartPoint=list_item_2, EndPoint=list_item_4)  # -> simplify(Line)
trim_tree_5 = TrimTree(Tree=list_item_2, Depth=1)
trim_tree_6 = TrimTree(Tree=line_2, Depth=1)
mesh = Mesh(mesh_brep)
connections_centers = Point(trim_tree_3)
connections_x_axis = Curve(trim_tree_4)
connections_centers_2 = Point(trim_tree_5)
mesh_2 = Mesh(mesh_brep_2)
connections_x_axis_2 = Curve(trim_tree_6)
tree_statistics_3 = TreeStatistics(Tree=mesh)  # -> Paths, Length, Count
char_sequence = CharSequence(Count=tree_statistics_3.Count, CharPool="ABCDEFGHIJKLMNOPQRSTUVWXYZ", Format="{0}")  # -> graft(Sequence)
conndir = Wasp_ConnectionFromDirection(GEO=mesh, CEN=connections_centers, UP=connections_x_axis)  # -> simplify(CONN), PLN_OUT; inputs GEO: Mesh, CEN: list of Point3d, UP: list of Curve, T: list; plug-in component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
preview = CustomPreview(
    Geometry=mesh_2,
    Material={diffuse=RGB(187, 179, 153), emission=RGB(0, 0, 0), shine=0, specular=RGB(255, 255, 255), transparency=0})
center_4 = Center(Geometry=mesh_2)  # -> Center, Dimension
part = Wasp_BasicPart(NAME=char_sequence, GEO=mesh, CONN=conndir.CONN)  # -> PART; inputs GEO: Mesh, CONN: list, ATTR: list; plug-in component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
rulegen = Wasp_RulesGenerator(PART=part)  # -> R; inputs PART: list, SELF_P: Boolean, SELF_C: Boolean, TYP: Boolean, GR: list; plug-in component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
vector_2pt = Vector2Pt(PointA=center_4.Center, PointB=connections_centers_2, Unitize=False)  # -> Vector, Length
number_slider_3 = Slider(94.24, range=0..250)
stochasticaggregation = Wasp_StochasticAggregation(PART=flatten(part), N=parts_num, RULES=rulegen, SEED=parts_num_2, RESET=reset)  # -> AGGR, PART_OUT; inputs PART: list, PREV: list, N: Int32, RULES: list, SEED: Int32, MODE: Int32, GC: list, RESET: Boolean; plug-in component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
query_model_objects_2 = QueryModelObjects(Layer="GOALS", Locked=True, Hidden=True, AutoUpdateState=True)
amplitude = Amplitude(Vector=vector_2pt.Vector, Amplitude=number_slider_3)
panel = Panel("""TOWER
BRIDGE
DOME""")
namefilter = Wasp_FilterPartsByName(PART=stochasticaggregation.PART_OUT, NAME=char_sequence)  # -> PART_OUT, MASK; inputs PART: list, NAME: list; plug-in component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
list_item_5 = ListItem(List=panel, Index=type_of_construction, Wrap=True)
list_item_6 = ListItem(List=query_model_objects_2, Index=type_of_construction, Wrap=True)
partgeo = Wasp_GetPartGeometry(PART=namefilter.PART_OUT)  # -> flatten(GEO); plug-in component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
concatenate = Concatenate(FragmentA="MAKE A ", FragmentB=list_item_5)
move = Move(Geometry=connections_centers_2, Motion=amplitude)  # -> Geometry, Transform
line_sdl = LineSDL(Start=connections_centers_2, Direction=amplitude, Length=number_slider_3)
list_indices = ListIndices(List=connections_centers_2)
stream_filter = StreamFilter(Gate=test_score, Stream1=partgeo)
custom_preview = CustomPreview(
    Geometry=list_item_6,
    Material={diffuse=RGB(0, 0, 0), emission=RGB(0, 0, 0), shine=1, specular=RGB(255, 255, 255), transparency=1})
text_tag_camera = TextTagCamera(Location=move.Geometry, Text=list_indices, Size=Slider(32, range=0..100), Colour=RGB(0, 0, 0))
shrinkwrap = ShrinkWrap(Geometry=stream_filter, Offset=Slider(100, range=0..100), Smoothing=0, Optimization=10, FillHoles=True)
preview_2 = CustomPreview(
    Geometry=partgeo,
    Material={diffuse=RGB(187, 179, 153), emission=RGB(0, 0, 0), shine=0, specular=RGB(255, 255, 255), transparency=0})
mesh_intersection = MeshIntersection(MeshesA=shrinkwrap, MeshesB=list_item_6)
custom_preview_2 = CustomPreview(
    Geometry=mesh_intersection,
    Material={diffuse=RGB(240, 230, 199), emission=RGB(0, 0, 0), shine=0, specular=RGB(255, 255, 255), transparency=0})
volume = Volume(Geometry=mesh_intersection)  # -> Volume, Centroid
volume_2 = Volume(Geometry=list_item_6)  # -> Volume, Centroid
division = Division(A=volume_2.Volume, B=volume.Volume)
round = Round(Number=division)  # -> Nearest, Floor, Ceiling
concatenate_2 = Concatenate(Fragment_A=round.Nearest, Fragment_B="/", A="100")
panel_2 = Panel(round.Nearest)
font_table = FontTable()
number_slider_4 = Slider(46, range=0..100)
panel_3 = Panel(font_table)
construct_point_2 = ConstructPoint(XCoordinate=Slider(30, range=0..100), YCoordinate=Slider(100, range=0..100), ZCoordinate=0)
list_item_7 = ListItem(List=panel_3, Index=Slider(53, range=0..100), Wrap=True)
concatenate_3 = Concatenate(Fragment_A="SCORE", A=" ", Fragment_B=concatenate_2)
construct_point_3 = ConstructPoint(XCoordinate=Slider(42, range=0..100), YCoordinate=Slider(898, range=0..1000), ZCoordinate=0)
colour_swatch = ColourSwatch(SwatchColor=RGB(255, 255, 255))
render_text_to_screen = RenderTextToScreen(
    Text=concatenate_3,
    Location=construct_point_2,
    Size=number_slider_4,
    Color=colour_swatch,
    Font=list_item_7,
    m_scWithvp=False)
render_text_to_screen_2 = RenderTextToScreen(
    Text=concatenate,
    Location=construct_point_3,
    Size=number_slider_4,
    Color=colour_swatch,
    Font=list_item_7,
    m_scWithvp=False)
